# Dynamo graph unit area naming.dyn (Dynamo 0.9.1.4062)

categories = Categories("Areas")
all_elements_of_category = ElementsOfCategory(categories)
code_block = CodeBlock { "Name"; }
boundaries = Custom[Room.Boundaries](room=all_elements_of_category)  # Gets a list of all boundary elements of a given room or area
endPoint = Curve.EndPoint()
map = List.Map(list=boundaries.curves, f_x=endPoint)
startPoint = Curve.StartPoint()
map_2 = List.Map(list=boundaries.curves, f_x=startPoint)
join = List.Join(map, map_2)
uniqueItems = List.UniqueItems(join)
byPerimeterPoints = Surface.ByPerimeterPoints(uniqueItems)
number = DoubleInput(8)
thicken = Surface.Thicken(surface=byPerimeterPoints, thickness=number)
code_block_2 = CodeBlock { "b.Unit Token"; }
byName = Family.ByName(code_block_2)
types = Family.Types(byName)
all_elements_of_family_type = ElementsOfFamilyType(types)
flatten = Flatten(all_elements_of_family_type)
location = FamilyInstance.Location(flatten)
ZAxis = Vector.ZAxis()
number_2 = DoubleInput(7.5)
scale = Vector.Scale(vector=ZAxis, scale_factor=number_2)
add = Point.Add(point=location, vectorToAdd=scale)
doesIntersect = Geometry.DoesIntersect(geometry=thicken, other=add, lacing=CrossProduct)
boolean = BoolSelector(true)
firstIndexOf = List.FirstIndexOf(item=boolean)
map_3 = List.Map(list=doesIntersect, f_x=firstIndexOf)
type = FamilyInstance.Type(flatten)
string = StringInput("Matrix_Name")
getParameterValueByName = Element.GetParameterValueByName(element=type, parameterName=string)
toUpper = String.ToUpper(getParameterValueByName)
string_2 = StringInput("UNIT ")
concat = String.Concat(string_2)
map_4 = List.Map(list=toUpper, f_x=concat)
getItemAtIndex = List.GetItemAtIndex(list=map_4)
map_5 = List.Map(list=map_3, f_x=getItemAtIndex)
isNull = Object.IsNull(map_5)
getParameterValueByName_2 = Element.GetParameterValueByName(element=all_elements_of_category, parameterName=code_block)
if_ = If(test=isNull, true=getParameterValueByName_2, false=map_5)
setParameterByName = Element.SetParameterByName(element=all_elements_of_category, parameterName=code_block, value=if_)  # frozen
