# Dynamo graph unit data.dyn (Dynamo 0.9.0.3067)

string = StringInput("b.Unit Token")
byName = Family.ByName(string)
types = Family.Types(byName)
string_2 = StringInput("Matrix_Name")
getParameterValueByName = Element.GetParameterValueByName(element=types, parameterName=string_2)
sortByKey = SortByKey(types, getParameterValueByName)
string_3 = StringInput("Type Comments")
getParameterValueByName_2 = Element.GetParameterValueByName(element=sortByKey, parameterName=string_3)
string_4 = StringInput("Project_Name")
getParameterValueByName_3 = Element.GetParameterValueByName(element=sortByKey, parameterName=string_4)
string_5 = StringInput("Area")
getParameterValueByName_4 = Element.GetParameterValueByName(element=sortByKey, parameterName=string_5)
string_6 = StringInput("Bedrooms")
getParameterValueByName_5 = Element.GetParameterValueByName(element=sortByKey, parameterName=string_6)
string_7 = StringInput("Baths")
getParameterValueByName_6 = Element.GetParameterValueByName(element=sortByKey, parameterName=string_7)
string_8 = StringInput("Den")
getParameterValueByName_7 = Element.GetParameterValueByName(element=sortByKey, parameterName=string_8)
string_9 = StringInput("Matrix_Name")
getParameterValueByName_8 = Element.GetParameterValueByName(element=sortByKey, parameterName=string_9)
create = List.Create(getParameterValueByName_2, getParameterValueByName_3, getParameterValueByName_4, getParameterValueByName_5, getParameterValueByName_6, getParameterValueByName_7, getParameterValueByName_8)
string_10 = StringInput("C:\Users\dklassen\Source\Repos\Dynamo-Unit Mix\sandbox\Yield Matrix.xlsx")
string_11 = StringInput("UnitSummary")
number = DoubleInput(0)
join = List.Join()
join_2 = List.Join()
code_block = CodeBlock { null; }
string_12 = StringInput("Area")
string_13 = StringInput("Bedrooms")
string_14 = StringInput("Baths")
string_15 = StringInput("Den")
string_16 = StringInput("FLOOR")
create_2 = List.Create(code_block, string_12, string_13, string_14, string_15, string_16)
categories = Categories("Levels")
all_elements_of_category = ElementsOfCategory(categories)
name = Level.Name(all_elements_of_category)
join_3 = List.Join(create_2, name)
create_3 = List.Create(join_3)
transpose = List.Transpose(create_3)
groupByKey = GroupByKey(types, getParameterValueByName)
string_17 = StringInput("Type Comments")
getParameterValueByName_9 = Element.GetParameterValueByName(parameterName=string_17)
map = List.Map(list=groupByKey, f_x=getParameterValueByName_9)
firstItem = List.FirstItem()
map_2 = List.Map(list=map, f_x=firstItem)
flatten = Flatten(map_2)
string_18 = StringInput("Area")
getParameterValueByName_10 = Element.GetParameterValueByName(parameterName=string_18)
map_3 = List.Map(list=groupByKey, f_x=getParameterValueByName_10)
firstItem_2 = List.FirstItem()
map_4 = List.Map(list=map_3, f_x=firstItem_2)
flatten_2 = Flatten(map_4)
string_19 = StringInput("Bedrooms")
getParameterValueByName_11 = Element.GetParameterValueByName(parameterName=string_19)
map_5 = List.Map(list=groupByKey, f_x=getParameterValueByName_11)
firstItem_3 = List.FirstItem()
map_6 = List.Map(list=map_5, f_x=firstItem_3)
flatten_3 = Flatten(map_6)
string_20 = StringInput("Baths")
getParameterValueByName_12 = Element.GetParameterValueByName(parameterName=string_20)
map_7 = List.Map(list=groupByKey, f_x=getParameterValueByName_12)
firstItem_4 = List.FirstItem()
map_8 = List.Map(list=map_7, f_x=firstItem_4)
flatten_4 = Flatten(map_8)
string_21 = StringInput("Den")
getParameterValueByName_13 = Element.GetParameterValueByName(parameterName=string_21)
map_9 = List.Map(list=groupByKey, f_x=getParameterValueByName_13)
firstItem_5 = List.FirstItem()
map_10 = List.Map(list=map_9, f_x=firstItem_5)
flatten_5 = Flatten(map_10)
string_22 = StringInput("Matrix_Name")
getParameterValueByName_14 = Element.GetParameterValueByName(parameterName=string_22)
map_11 = List.Map(list=groupByKey, f_x=getParameterValueByName_14)
firstItem_6 = List.FirstItem()
map_12 = List.Map(list=map_11, f_x=firstItem_6)
flatten_6 = Flatten(map_12)
create_4 = List.Create(flatten, flatten_2, flatten_3, flatten_4, flatten_5, flatten_6)
all_elements_of_family_type = ElementsOfFamilyType(groupByKey)
number_2 = DoubleInput(1)
flatten_7 = List.Flatten(amt=number_2)
map_13 = List.Map(list=all_elements_of_family_type, f_x=flatten_7)
string_23 = StringInput("Level")
getParameterValueByName_15 = Element.GetParameterValueByName(element=map_13, parameterName=string_23)
name_2 = Level.Name(getParameterValueByName_15)
allIndicesOf = List.AllIndicesOf(item=name)
map_14 = List.Map(list=name_2, f_x=allIndicesOf)
count = List.Count()
map_15 = List.Map(f_x=count)
map_16 = List.Map(list=map_14, f_x=map_15)
transpose_2 = List.Transpose(map_16)
join_4 = List.Join(create_4, transpose_2)
combine = List.Combine(join_2, transpose, join_4)
string_24 = StringInput("TOTAL")
code_block_2 = CodeBlock { null; }
number_3 = DoubleInput(5)
ofRepeatedItem = List.OfRepeatedItem(item=code_block_2, amount=number_3)
addItemToEnd = List.AddItemToEnd(string_24, ofRepeatedItem)
sum = Math.Sum(transpose_2)
join_5 = List.Join(addItemToEnd, sum)
create_5 = List.Create(join_5)
transpose_3 = List.Transpose(create_5)
combine_2 = List.Combine(join, combine, transpose_3)
boolean = BoolSelector(false)
writeToFile = Excel.WriteToFile(filePath=string_10, sheetName=string_11, startRow=number, startCol=number, data=combine_2, overWrite=boolean)
all_elements_of_family_type_2 = ElementsOfFamilyType(sortByKey)
string_25 = StringInput("Level")
getParameterValueByName_16 = Element.GetParameterValueByName(element=all_elements_of_family_type_2, parameterName=string_25)
string_26 = StringInput("Name")
getParameterValueByName_17 = Element.GetParameterValueByName(element=getParameterValueByName_16, parameterName=string_26)
flatten_8 = Flatten(getParameterValueByName_17)
uniqueItems = List.UniqueItems(flatten_8)
sort = List.Sort(uniqueItems)
allIndicesOf_2 = List.AllIndicesOf(item=sort)
map_17 = List.Map(list=getParameterValueByName_17, f_x=allIndicesOf_2)
count_2 = List.Count()
map_18 = List.Map(f_x=count_2)
map_19 = List.Map(list=map_17, f_x=map_18)
transpose_4 = List.Transpose(map_19)
