# Dynamo graph unit naming.dyn (Dynamo 0.9.0.3067)

categories = Categories("Rooms")
all_elements_of_category = ElementsOfCategory(categories)
geometry = Element.Geometry(all_elements_of_category)
code_block = CodeBlock { 1; }
flatten = List.Flatten(list=geometry, amt=code_block)
centroid = Solid.Centroid(flatten)
element_types = ElementTypes("Group")
all_elements_of_type = ElementsOfType(element_types)
name = Element.Name(all_elements_of_type)
code_block_2 = CodeBlock { "UNIT"; }
startsWith = String.StartsWith(str=name, searchFor=code_block_2)
filterByBoolMask = List.FilterByBoolMask(list=all_elements_of_type, mask=startsWith)
boundingBox = Element.BoundingBox(filterByBoolMask.in)
contains = BoundingBox.Contains(boundingBox)
map = List.Map(list=centroid, f_x=contains)
boolean = BoolSelector(true)
firstIndexOf = List.FirstIndexOf(item=boolean)
map_2 = List.Map(list=map, f_x=firstIndexOf)
name_2 = Element.Name(filterByBoolMask.in)
getItemAtIndex = List.GetItemAtIndex(list=name_2)
map_3 = List.Map(list=map_2, f_x=getItemAtIndex)
name_3 = Element.Name(all_elements_of_category)
create = List.Create(map_3, name_3)
transpose = List.Transpose(create)
