# Dynamo graph unit room naming.dyn (Dynamo 0.9.1.4062)

code_block = CodeBlock { "b.Unit Token"; }
byName = Family.ByName(code_block)
types = Family.Types(byName)
name = FamilyType.Name(types)
categories = Categories("Rooms")
all_elements_of_category = ElementsOfCategory(categories)
code_block_2 = CodeBlock { "Name"; }
geometry = Element.Geometry(all_elements_of_category)
code_block_3 = CodeBlock { 1; }
flatten = List.Flatten(list=geometry, amt=code_block_3)
all_elements_of_family_type = ElementsOfFamilyType(types)
flatten_2 = Flatten(all_elements_of_family_type)
location = FamilyInstance.Location(flatten_2)
ZAxis = Vector.ZAxis()
add = Point.Add(point=location, vectorToAdd=ZAxis)
doesIntersect = Geometry.DoesIntersect(geometry=flatten, other=add, lacing=CrossProduct)
boolean = BoolSelector(true)
firstIndexOf = List.FirstIndexOf(item=boolean)
map = List.Map(list=doesIntersect, f_x=firstIndexOf)
name_2 = Element.Name(flatten_2)
toUpper = String.ToUpper(name_2)
getItemAtIndex = List.GetItemAtIndex(list=toUpper)
map_2 = List.Map(list=map, f_x=getItemAtIndex)
isNull = Object.IsNull(map_2)
getParameterValueByName = Element.GetParameterValueByName(element=all_elements_of_category, parameterName=code_block_2)
if_ = If(test=isNull, true=getParameterValueByName, false=map_2)
setParameterByName = Element.SetParameterByName(element=all_elements_of_category, parameterName=code_block_2, value=if_)  # frozen
