# Dynamo graph units.dyn (Dynamo 0.9.0.3067)

get_type_of_group = Python()
# ---------- get_type_of_group.python (14 lines) ----------
import clr
clr.AddReference('ProtoGeometry')
from Autodesk.DesignScript.Geometry import *
#The inputs to this node will be stored as a list in the IN variables.
dataEnteringNode = IN

items = UnwrapElement(IN[0])
grouplist = list()

for item in items:
	grouplist.append(item.GroupType)

#Assign your output to the OUT variable.
OUT = grouplist
# ----------------------------------------
element_types = ElementTypes("GroupType")
all_elements_of_type = ElementsOfType(element_types)
name = Element.Name(all_elements_of_type)
element_types_2 = ElementTypes("Group")
all_elements_of_type_2 = ElementsOfType(element_types_2)
name_2 = Element.Name(all_elements_of_type_2)
allIndicesOf = List.AllIndicesOf(list=name_2, item=name)
count = List.Count()
map = List.Map(list=allIndicesOf, f_x=count)
firstIndexOf = List.FirstIndexOf(list=name_2, item=name)
getItemAtIndex = List.GetItemAtIndex(list=all_elements_of_type_2, index=firstIndexOf)
get_group_members = Python(IN[0]=getItemAtIndex)
# ---------- get_group_members.python (9 lines) ----------
import clr
dataEnteringNode = IN

groups = UnwrapElement(IN[0])
groupMemberList = list()
for group in groups:
	groupMemberList.append(group.GetMemberIds())

OUT = groupMemberList
# ----------------------------------------
get_elements_by_id = Python(IN[0]=get_group_members)
# ---------- get_elements_by_id.python (27 lines) ----------
import clr
dataEnteringNode = IN

clr.AddReference('RevitAPI')
from Autodesk.Revit.DB import *
clr.AddReference("RevitNodes")
import Revit
clr.ImportExtensions(Revit.Elements)
clr.AddReference("RevitServices")
import RevitServices
from RevitServices.Persistence import DocumentManager

doc = DocumentManager.Instance.CurrentDBDocument
groups = UnwrapElement(IN[0])

grouplist = list()
for group in groups:
	memberlist = list()
	for member in group:
		element = doc.GetElement(member)
		#memberlist.append(element.GetType())
		if element.GetType().ToString() == "Autodesk.Revit.DB.ModelLine":
			if element.LineStyle.Name == "b.UnitOutline":
				memberlist.append(doc.GetElement(member))
	grouplist.append(memberlist)
	
OUT = grouplist
# ----------------------------------------
curve = CurveElement.Curve()
map_2 = List.Map(list=get_elements_by_id, f_x=curve)
byJoinedCurves = PolyCurve.ByJoinedCurves(map_2)
byPatch = Surface.ByPatch(byJoinedCurves)
area = Surface.Area(byPatch)
create = List.Create(name, map, area)
watch = Watch(create)
name_3 = Element.Name()
string = StringInput("UNIT-")
startsWith = String.StartsWith(str=name_3, searchFor=string)
filter = List.Filter(all_elements_of_type_2, startsWith)
